# Dynamo graph Model to Graph.dyn (Dynamo 2.12.0.5650)
# packages: Autodesk Analytical Modeling 2022 Dynamo 1.0.1, Genius Loci 2022.4.19, Rhythm 2022.4.3

# group: Slabs' Features
categories = Categories("OST_Floors")
all_elements_of_category = ElementsOfCategory(Category=categories)
string = StringInput("Thickness")
get_slabs_thickness = Element.GetParameterValueByName(element=all_elements_of_category, parameterName=string)
getJoinedElements = Element.GetJoinedElements(element=all_elements_of_category)
string_2 = StringInput("Mark")
get_slabs_connections = Element.GetParameterValueByName(element=getJoinedElements, parameterName=string_2)
getAnalyticalElement = Dynamo4AM.Utilities.FilterElements.GetAnalyticalElement(obj=all_elements_of_category)
boolean = BoolSelector(true)
getSurfaceFromAnalyticalElement = Dynamo4AM.Utilities.FilterElements.GetSurfaceFromAnalyticalElement(obj=getAnalyticalElement, includeBoundaries=boolean)
get_slabs_surfaces = List.FirstItem(list=getSurfaceFromAnalyticalElement, lacing=Shortest)
boolean_2 = BoolSelector(true)
surface_inner_centroid = Custom[Surface Inner Centroid](surface=get_slabs_surfaces, with_distance=boolean_2)  # package Genius Loci; Finds pole of inaccessibility for a given polygon. Calculates the visual center of a polygon (inside the polygon). Based on Vladimir Agafonkin's algorithm Polylabel. Please note that the node doesn't work with ellipsoidal or circular surfaces.
byCenterPointRadius = Circle.ByCenterPointRadius(centerPoint=surface_inner_centroid.Centroid, radius=surface_inner_centroid.Distance)
calculate_inner_circles_diameter = CodeBlock(circle1=byCenterPointRadius) { R = Circle.Radius(circle1); Diameter = R * 2; }
list_create = List.Create()  # unwired: item0, item1
watch = Watch(surface_inner_centroid.Centroid)
categories_2 = Categories("OST_StructuralColumns")
string_3 = StringInput("Contains")
ʳʰʸᵗʰᵐ_elementfilter_bycategory = Rhythm.Revit.ElementFilter.ElementFilter.ByCategory(elements=getJoinedElements, category=categories_2, filterMethod=string_3)
getAnalyticalElement_2 = Dynamo4AM.Utilities.FilterElements.GetAnalyticalElement(obj=ʳʰʸᵗʰᵐ_elementfilter_bycategory)
getPointsFromAnalyticalElement = Dynamo4AM.Utilities.FilterElements.GetPointsFromAnalyticalElement(obj=getAnalyticalElement_2)
string_from_object = FromObject(object=getPointsFromAnalyticalElement)
getting_only_the_upper_points = CodeBlock(strList=string_from_object, points=getPointsFromAnalyticalElement)
# ---------- getting_only_the_upper_points.designscript (4 lines) ----------
strMask = "Z = 0.000";
mask = String.Contains(strList, strMask, false);
dictMask = List.FilterByBoolMask(points, mask);
filtered = Dictionary.ValueAtKey(dictMask, "out");
# ----------------------------------------
distanceTo = Geometry.DistanceTo(geometry=watch, other=getting_only_the_upper_points.filtered)
categories_3 = Categories("OST_Walls")
string_4 = StringInput("Contains")
ʳʰʸᵗʰᵐ_elementfilter_bycategory_2 = Rhythm.Revit.ElementFilter.ElementFilter.ByCategory(elements=getJoinedElements, category=categories_3, filterMethod=string_4)
getAnalyticalElement_3 = Dynamo4AM.Utilities.FilterElements.GetAnalyticalElement(obj=ʳʰʸᵗʰᵐ_elementfilter_bycategory_2)
getSurfaceFromAnalyticalElement_2 = Dynamo4AM.Utilities.FilterElements.GetSurfaceFromAnalyticalElement(obj=getAnalyticalElement_3)
firstItem = List.FirstItem(list=getSurfaceFromAnalyticalElement_2@@L2)
distanceTo_2 = Geometry.DistanceTo(geometry=watch, other=firstItem)
combine = List.Combine(combineFunction=list_create, list0=distanceTo, list1=distanceTo_2)
flatten = List.Flatten()  # unwired: list
map = List.Map(list=combine, function=flatten)
minimumItem = List.MinimumItem(list=map)
code_block = CodeBlock { 0.001; }
add = minimumItem + code_block
gt = calculate_inner_circles_diameter.R > add
string_5 = StringInput("Mark")
get_slabs_mark = Element.GetParameterValueByName(element=all_elements_of_category, parameterName=string_5)

# group: Columns' Features
categories_4 = Categories("OST_StructuralColumns")
all_elements_of_category_2 = ElementsOfCategory(Category=categories_4)
filter_out_sofistik = CodeBlock(columnList=all_elements_of_category_2)  # "Filter out "SOFiSTIK_ReferencePoint""
# ---------- filter_out_sofistik.designscript (4 lines) ----------
families = Family.Name(columnList);
familyToFilter = "SOFiSTiK_ReferencePoint";
indices = List.AllIndicesOf(families, familyToFilter);
filteredList = List.RemoveItemAtIndex(columnList, indices);
# ----------------------------------------
getJoinedElements_2 = Element.GetJoinedElements(element=filter_out_sofistik.filteredList)
string_6 = StringInput("Mark")
get_columns_connections = Element.GetParameterValueByName(element=getJoinedElements_2, parameterName=string_6)
name = Element.Name(element=filter_out_sofistik.filteredList)
string_7 = StringInput("Length")
get_columns_length = Element.GetParameterValueByName(element=filter_out_sofistik.filteredList, parameterName=string_7)
string_8 = StringInput("Mark")
get_columns_mark = Element.GetParameterValueByName(element=filter_out_sofistik.filteredList, parameterName=string_8)

# group: Beams' Features
categories_5 = Categories("OST_StructuralFraming")
all_elements_of_category_3 = ElementsOfCategory(Category=categories_5)
string_9 = StringInput("Length")
get_beams_length = Element.GetParameterValueByName(element=all_elements_of_category_3, parameterName=string_9)
name_2 = Element.Name(element=all_elements_of_category_3)
get_joined_elements = Custom[Get Joined Elements](element=all_elements_of_category_3@L1)  # package Genius Loci; Returns all elements joined to the given element.
string_10 = StringInput("Mark")
# note: Check if some connections are missing and why
get_beams_connections = Element.GetParameterValueByName(element=get_joined_elements, parameterName=string_10)
string_11 = StringInput("Mark")
get_beams_mark = Element.GetParameterValueByName(element=all_elements_of_category_3, parameterName=string_11)

# group: Walls' Features
categories_6 = Categories("OST_Walls")
all_elements_of_category_4 = ElementsOfCategory(Category=categories_6)
get_joined_elements_2 = Custom[Get Joined Elements](element=all_elements_of_category_4@L1)
string_12 = StringInput("Mark")
# note: Check if some connections are missing and why
get_walls_connections = Element.GetParameterValueByName(element=get_joined_elements_2, parameterName=string_12)
get_walls_width = Element.Name(element=all_elements_of_category_4)
string_13 = StringInput("Length")
get_walls_length = Element.GetParameterValueByName(element=all_elements_of_category_4, parameterName=string_13)
string_14 = StringInput("Unconnected Height")
get_walls_height = Element.GetParameterValueByName(element=all_elements_of_category_4, parameterName=string_14)
string_15 = StringInput("Mark")
get_walls_mark = Element.GetParameterValueByName(element=all_elements_of_category_4, parameterName=string_15)

# group: Script Input
directory_path = Directory("C:\Users\A.D.A\OneDrive - Technion\Research Data\VSCode\Dynamo")

# group: Nodes.csv
string_16 = StringInput("\Nodes.csv")
concat = String.Concat(string0=directory_path, string1=string_16)
list_create_2 = List.Create(item0=get_slabs_mark, item1=get_columns_mark, item2=get_beams_mark, item3=get_walls_mark)
flatten_2 = List.Flatten(list=list_create_2)
exportCSV = Data.ExportCSV(filePath=concat, data=flatten_2)
